% Requirement links of Requisitos_NASH_Planta_MCP_ER_Prop_V1e_.slreqx (R2020a)

#26 verifies #10: 001-F-MCP-008-1: Por meio da IHM do simulador, o modelo do MCP deve permitir a inserção de falha pressão de boost diferente de zero.
#26 implements #10: 001-F-MCP-008-1: Por meio da IHM do simulador, o modelo do MCP deve permitir a inserção de falha pressão de boost diferente de zero.
#27 implements #4: 001-F-MCP-003: No estado do motor desligado, o modelo do MCP deve ignorar comandos de demanda de rotação.
#27 implements #5: 001-F-MCP-004: No estado de motor parado, o modelo do MCP deve representar o valor de rotação igual a 0 RPM.
#28 implements #6: 001-F-MCP-005: Quando em ralenti, o modelo do MCP deve representar o valor de rotação igual a 600 RPM.
#28 implements #7: 001-F-MCP-006: No estado de motor rodando, o modelo do MCP deve representar a dinâmica de rotação do motor de acordo com a demanda e com o estado da engrenagem reversora.
#28 implements #8: 001-F-MCP-007: A dinâmida de rotação do modelo do MCP deve apresentar o comportamento do motor representado no EST-156.
#30 implements #9: 001-F-MCP-008: Por meio da IHM do simulador, o modelo do MCP deve permitir a inserção de falhas pelo operador do sistema.
#30 implements #11: 001-F-MCP-008-2: Por meio da IHM do simulador, o modelo do MCP deve permitir a inserção de falha temperatura de exaustão fora da faixa de operação normal.
#30 implements #12: 001-F-MCP-008-3: Por meio da IHM do simulador, o modelo do MCP deve permitir a inserção de falha do sinal de rotação do MCP.
#30 implements #13: 001-F-MCP-008-4: Por meio da IHM do simulador, o modelo do MCP deve permitir a inserção de falha de pressão de óleo lubrificante.
#30 implements #14: 001-F-MCP-008-5: Por meio da IHM do simulador, o modelo do MCP deve permitir a inserção de falha de temperatura de água de resfriamento.
#30 implements #15: 001-F-MCP-008-6: Por meio da IHM do simulador, o modelo do MCP deve permitir a inserção de falha de pressão de ar.